# Grasshopper definition 01_TimeComparision.gh (Grasshopper 1.0.8)

pow = Power(A="10", B=Slider(9, range=1..9))
panel = Panel(pow)
S = Script(it=panel)  # -> out, a; inputs it: Int32
# ---------- S: Python ----------
from System.Diagnostics import Stopwatch

time = Stopwatch()
time.Start()

for i in range(it):
    b = i
time.Stop()
a = time.Elapsed
# ---------- end S ----------
S_2 = Script(it=panel)  # -> out, a; inputs it: Int32
# ---------- S_2: C# ----------
// Grasshopper Script Instance
#region Usings
using System;
using System.Linq;
using System.Collections;
using System.Collections.Generic;
using System.Drawing;

using Rhino;
using Rhino.Geometry;

using Grasshopper;
using Grasshopper.Kernel;
using Grasshopper.Kernel.Data;
using Grasshopper.Kernel.Types;
using System.Diagnostics;
#endregion

public class Script_Instance : GH_ScriptInstance
{

    private void RunScript(int it, ref object a)
    {
        Stopwatch timer = new Stopwatch();
        timer.Start();
        int b;
        for (int i = 0; i < it ; i++){
            b = i;
        }
        timer.Stop();
        a = timer.Elapsed;
    }
}
# ---------- end S_2 ----------
# Elapsed Time
panel_2 = Panel(S.a)
panel_3 = Panel(S_2.a)
