# Grasshopper definition 02_PointBouncing.gh (Grasshopper 1.0.8)

trigger = Trigger(Interval=50, TimerInterval=50, Target=S)
S = Script(reset=Button(), velocity=Slider(1.7, range=0.1..2))  # -> out, a; inputs reset: Boolean, velocity: Double
# ---------- S: C# ----------
// Grasshopper Script Instance
#region Usings
using System;
using System.Linq;
using System.Collections;
using System.Collections.Generic;
using System.Drawing;

using Rhino;
using Rhino.Geometry;

using Grasshopper;
using Grasshopper.Kernel;
using Grasshopper.Kernel.Data;
using Grasshopper.Kernel.Types;
#endregion

public class Script_Instance : GH_ScriptInstance
{
	
    Point3d pt = new Point3d(0, 0, 0);
	List <Point3d> pts = new List<Point3d>();
    double xDirection = 1;
    double yDirection = 1;

    private void RunScript(bool reset, double velocity, ref object a)
    {

		Random genRandom = new Random();

        if (reset)
        {
			pts.Clear();
            pt = new Point3d(genRandom.NextDouble() , genRandom.NextDouble() , 0);
			xDirection = genRandom.NextDouble();
			yDirection = genRandom.NextDouble();
        }
        else
        {
            if (pt.X > 10 || pt.X < -10) xDirection *= -1;
            if (pt.Y > 10 || pt.Y < -10) yDirection *= -1;

            Vector3d vMovement = new Vector3d(xDirection, yDirection, 0);
            pt += vMovement * velocity;
			pts.Add(pt);
        }

        a = pts;
    }
}
# ---------- end S ----------
